# Grasshopper definition create_rapid_tooldata.gh (Grasshopper 1.0.7)

# Prism centre point co-ords:
#     Point at (-18.776,-111.624,-189.561)
pt = ConstructPoint(
    XCoordinate=Slider(-18.776, range=-18.776..0),
    YCoordinate=Slider(-111.624, range=-111.624..0),
    ZCoordinate=Slider(189.561, range=0..1000))
xy = XYPlane(Origin=pt)
pflip = FlipPlane(Plane=xy, ReverseX=False, ReverseY=False, SwapAxes=True)

# ---- group: TCP 2
line = Line(Line((0, 0, 348.995388), (0, 0, 0)))

# ---- group: TCP 3
line_2 = Line(Line((4.388436597e-07, 293.047182, 246.3801507), (0, 0, 0)))

# ---- group: TCP 1
# Tooldata for trident tool
line_3 = Line(Line((4.388436597e-07, -293.047182, 246.3801507), (0, 0, 0)))

# ----
end = EndPoints(Curve=line_3)  # -> Start, End
end_2 = EndPoints(Curve=line)  # -> Start, End
end_3 = EndPoints(Curve=line_2)  # -> Start, End
pl = PlaneNormal(Origin=end.Start, ZAxis=line_3)
pl_2 = PlaneNormal(Origin=end_2.Start, ZAxis=line)
pl_3 = PlaneNormal(Origin=end_3.Start, ZAxis=line_2)
prot = RotatePlane(Plane=pl_2, Angle=degrees(Slider(90, range=0..100)))
pflip_2 = FlipPlane(Plane=pl, ReverseX=False, ReverseY=False, SwapAxes=True)
pflip_3 = FlipPlane(Plane=prot, ReverseX=False, ReverseY=False, SwapAxes=True)
pflip_4 = FlipPlane(Plane=pl_3, ReverseX=False, ReverseY=False, SwapAxes=True)
number_slider = Slider(90, range=0..360)
prot_2 = RotatePlane(Plane=pflip_2, Angle=degrees(number_slider))
prot_3 = RotatePlane(Plane=pflip_3, Angle=degrees(number_slider))
prot_4 = RotatePlane(Plane=pflip_4, Angle=degrees(number_slider))
bang = Button()
python = GhPythonScript(plane=pflip, name="A057_ClayTool02_Prism", weight=Slider(1, range=0..1))  # -> out, tooldata; inputs plane: Plane, cog_pt: Point3d
# ---------- python: Python ----------
from compas_rcf.abb.helpers import RapidToolData

kwargs = {}
if cog_pt:
    kwargs.update({"cog_pt": cog_pt})
if name:
    kwargs.update({"name": name})
if weight:
    kwargs.update({"weight": name})

tool = RapidToolData.from_plane_point(plane, **kwargs, tolerace=1e-3)
tooldata = str(tool)
# ---------- end python ----------
python_2 = GhPythonScript(plane=prot_3)  # -> out, tooldata; inputs plane: Plane, cog_pt: Point3d
# ---------- python_2: Python ----------
from compas_rcf.abb.helpers import RapidToolData

kwargs = {}
if cog_pt:
    kwargs.update({"cog_pt": cog_pt})
if name:
    kwargs.update({"name": name})
if weight:
    kwargs.update({"weight": name})

tool = RapidToolData.from_plane_point(plane, **kwargs)
tooldata = str(tool)
# ---------- end python_2 ----------
python_3 = GhPythonScript(plane=prot_4)  # -> out, tooldata; inputs plane: Plane, cog_pt: Point3d; same code as python_2
unload = PythonScript(bang=bang, module="compas_rcf")
# ---------- unload: Python ----------
import sys

def unload_modules(top_level_module_name):
    """Unloads all modules named starting with the specified string.

    This function eases the development workflow when editing a library that is
    used from Rhino/Grasshopper.

    Args:
        top_level_module_name (:obj:`str`): Name of the top-level module to unload.

    Returns:
        list: List of unloaded module names.
    """
    modules = filter(lambda m: m.startswith(top_level_module_name), sys.modules)

    for module in modules:
        sys.modules.pop(module)

    return modules

unload_modules(module)
# ---------- end unload ----------
panel = Panel(python.tooldata)
panel_2 = Panel(python_2.tooldata)
panel_3 = Panel(python_3.tooldata)
